# Grasshopper definition run_ghe_designer.gh (Grasshopper 1.0.7)
# plug-ins: CORE.Toolbox.Grasshopper

# ---- group: Set to True to Read Excel File
toggle = BooleanToggle(True)

# ---- group: Set the Path to the Plant Load Excel File
path = FilePath("C:\Users\chris\Downloads\2024-0209 plant loads.xlsx")

# ---- group: Process Excel of Hourly Loads in Btu/h into Watts
xl_in = ReadFromExcel(WorkbookFilepath=path, Live=False, Stream=toggle)
flip = FlipMatrix(Data=xl_in)
panel = Panel("""0
1""")
panel_2 = Panel("""2
3
4
5""")
cull_i = CullIndex(List=flip, Indices=panel, Wrap=True)  # -> simplify(List)
branch = TreeBranch(Tree=cull_i, Path=panel_2, MaintainPaths=True)
units = LBUnitConverter(values=branch, from_u="Btu/h", to_u="W")  # -> all_u, values; plug-in component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
bang = ExplodeTree(Data=units.values)  # -> Branch0, Branch1, Branch2, Branch3
neg = Negative(Value=bang.Branch0)
neg_2 = Negative(Value=bang.Branch1)
constrheader = LBConstructHeader(data_type="Power", unit="W")  # -> header; plug-in component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
addition = Addition(A=neg, B=neg_2, C=bang.Branch2, D=bang.Branch3)
data = LBConstructData(header=constrheader, values=addition)  # -> data; plug-in component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

# ----
ghedesigner = HBGHEDesigner(
    min_spacing=Slider(7, range=0..15),
    max_spacing=Slider(35, range=5..50),
    min_depth=Slider(150, range=100..300),
    max_depth=Slider(500, range=300..600))  # -> geo_constr; plug-in component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
site_geometry = Geometry(<curve referenced from the Rhino model>)
ghedesigner_2 = HBGHEDesigner(load=data, site=site_geometry, geo_constr=ghedesigner, write=Toggle(False))  # -> report, input_json, boreholes, g_function, idf_text; plug-in component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
panel_3 = Panel(ghedesigner_2.report)
